# Dynamo graph json_export.dyn (Dynamo 2.19.3.6394)

file_path = Filename(".\all.json")
categories = Categories("OST_Walls")
categories_2 = Categories("OST_Doors")
categories_3 = Categories("OST_Windows")
categories_4 = Categories("OST_DuctCurves")
categories_5 = Categories("OST_Floors")
categories_6 = Categories("OST_Ceilings")
list_create = List.Create(item0=categories, item1=categories_2, item2=categories_3, item3=categories_4, item4=categories_5, item5=categories_6)
all_elements_of_category = ElementsOfCategory(Category=list_create)
parameters = Element.Parameters(element=all_elements_of_category)
python_script = Python(IN[0]=parameters)  # CPython3
# ---------- python_script.python (38 lines) ----------
# Load the Python Standard and DesignScript Libraries
import sys
import clr
clr.AddReference('ProtoGeometry')
from Autodesk.DesignScript.Geometry import *

# The inputs to this node will be stored as a list in the IN variables.
dataEnteringNode = IN

# Place your code below this line
all = dataEnteringNode[0]
out = 0
all = all
all_list = []
for cat in all:
    cat_list = []
    for elem in cat:
        #print(elem)
        #e_list = []
        e_dict = {}
        for param in elem:
            k = str(param.Name)
            v = str(param.Value)#Core.String.Action.StringFromObject(param.Value)
            #out = (k, v)#Name#type(param)
            #e_list += [(k, v)]
            e_dict[k] = v 
            #break
        #out = e_list
        #cat_list += [e_list]
        cat_list += [e_dict]
        #break 
    all_list += [cat_list]
    #break
    
out = all_list

# Assign your output to the OUT variable.
OUT = out
# ----------------------------------------
stringifyJSON = Data.StringifyJSON(values=python_script)
exportCSV = Data.ExportCSV(filePath=file_path, data=stringifyJSON)
string_from_array = FromArray(array=parameters)
